# Grasshopper definition 01_Generative Urbanism_Niveditha_B.gh (Grasshopper 1.0.7)
# plug-ins: Human

pts_topography = Point([<point referenced from the Rhino model> x3])  # disabled
crv_boundary = Curve(<curve referenced from the Rhino model>)  # disabled

srf_topography = Surface(<surface referenced from the Rhino model>)  # disabled
crv_boundary_2 = Curve(<curve referenced from the Rhino model>)  # disabled
crv_railways = Curve(<curve referenced from the Rhino model>)  # disabled
crv_streets = Curve([<curve referenced from the Rhino model> x159])  # disabled
pt_points = Point([<point referenced from the Rhino model> x5])  # disabled

boundary = BoundarySurfaces(Edges=crv_boundary)  # disabled

# ---- group: Join Streets
crv_streets_2 = Curve(crv_streets)  # disabled
objatts = ObjectAttributes(ObjectOrAttributes=crv_streets_2)  # -> Name, LayerName, LayerFullPath, Color, MaterialName, LinetypeName, GroupIndices, PlotWeight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; disabled
item = ListItem(List=objatts.UserDataValues, Index=0, Wrap=True)  # -> flatten(Item); disabled
cset = CreateSet(List=item)  # -> graft(Set), Map; disabled
equals = Equality(FirstNumber=cset.Set, SecondNumber=item)  # -> Equality, Inequality; disabled
cull = CullPattern(List=crv_streets_2, CullPattern=equals.Equality)  # disabled
join = JoinCurves(Curves=cull, Preserve=False)  # disabled
lng = ListLength(List=join)  # disabled
dup = DuplicateData(Data=cset.Set, Number=lng, Order=True)  # disabled

# ---- group: Land Division
crv_boundary_3 = Curve(crv_boundary_2)  # disabled
crv_railways_2 = Curve(crv_railways)  # disabled

boundary_2 = BoundarySurfaces(Edges=crv_boundary_3)  # disabled
area = Area(Geometry=crv_railways_2)  # -> Area, Centroid; disabled
srfsplit = SurfaceSplit(Surface=boundary_2, Curves=crv_railways_2)  # -> graft(Fragments); disabled
srf_cp = SurfaceClosestPoint(Point=area.Centroid, Surface=srfsplit)  # -> Point, UVPoint, Distance; disabled
sort = SortList(Keys=srf_cp.Distance)  # -> Keys, ValuesA; disabled
panel = Panel("0.1")  # disabled
item_2 = ListItem(List=sort.Keys, Index=0, Wrap=True)  # disabled
smaller = SmallerThan(FirstNumber=item_2, SecondNumber=panel)  # -> SmallerThan, OrEqualTo; disabled
dispatch = Dispatch(List=srfsplit, DispatchPattern=smaller.SmallerThan)  # -> ListA, ListB; disabled

# ---- group: Join Streets
num_streetwidths = Number(flatten(dup))  # disabled
crv_streets_3 = Curve(flatten(join))  # disabled

# ---- group: Land Division
srf_land = Surface(dispatch.ListB)  # disabled
srf_railways = Surface(dispatch.ListA)  # disabled

# ---- group: Blocks
num_streetwidths_2 = Number(flatten(num_streetwidths))  # disabled
crv_streets_4 = Curve(flatten(crv_streets_3))  # disabled
srf_land_2 = Surface(flatten(srf_land))  # disabled

offset = OffsetCurve(Curve=graft(crv_streets_4), Distance=expr("-x/2", graft(num_streetwidths_2)), Corners=1)  # disabled
offset_2 = OffsetCurve(Curve=graft(crv_streets_4), Distance=expr("x/2", graft(num_streetwidths_2)), Corners=1)  # disabled
srfsplit_2 = SurfaceSplit(Surface=srf_land_2, Curves=crv_streets_4)  # disabled
graft = GraftTree(Tree=srfsplit_2, IncludeEmptyLists=True, IncludeNullItems=True)  # disabled
end = EndPoints(Curve=offset_2)  # -> Start, End; disabled
end_2 = EndPoints(Curve=offset)  # -> Start, End; disabled
edges = BrepEdges(Brep=graft)  # -> Naked, Interior, NonManifold; disabled
ln = Line(StartPoint=end.Start, EndPoint=end_2.Start)  # disabled
ln_2 = Line(StartPoint=end.End, EndPoint=end_2.End)  # disabled
join_2 = JoinCurves(Curves=edges.Naked, Preserve=False)  # disabled
area_2 = Area(Geometry=join_2)  # -> Area, Centroid; disabled
join_3 = JoinCurves(Curves=[ln_2, ln, offset, offset_2], Preserve=False)  # disabled
flatten = FlattenTree(Tree=join_3, Path="{0}")  # disabled
srfsplit_3 = SurfaceSplit(Surface=graft, Curves=flatten)  # disabled
flatten_2 = FlattenTree(Tree=area_2.Centroid, Path="{0}")  # disabled
graft_2 = GraftTree(Tree=srfsplit_3, IncludeEmptyLists=True, IncludeNullItems=True)  # disabled
srf_cp_2 = SurfaceClosestPoint(Point=flatten_2, Surface=graft_2)  # -> Point, UVPoint, Distance; disabled
sort_2 = SortList(Keys=srf_cp_2.Distance)  # -> Keys, ValuesA; disabled
item_3 = ListItem(List=sort_2.Keys, Index=0, Wrap=True)  # disabled
panel_2 = Panel("0.1")  # disabled
smaller_2 = SmallerThan(FirstNumber=item_3, SecondNumber=panel_2)  # -> SmallerThan, OrEqualTo; disabled
cull_2 = CullPattern(List=graft_2, CullPattern=smaller_2.SmallerThan)  # disabled
edges_2 = BrepEdges(Brep=flatten(cull_2))  # -> Naked, Interior, NonManifold; disabled
join_4 = JoinCurves(Curves=edges_2.Naked, Preserve=False)  # disabled
crv_blocks = Curve(flatten(join_4))  # disabled

# ----
srf_blocks = Surface()  # disabled
dispatch_2 = Dispatch(List=crv_blocks, DispatchPattern=[True, False])  # -> graft(ListA), graft(ListB); disabled
panel_3 = Panel("4")  # disabled
panel_4 = Panel("10")  # disabled

# ---- group: Building Widths
crv_blocks_2 = Curve(simplify(graft(dispatch_2.ListA)))  # disabled
num_minwidth = Number(panel_3)  # disabled
num_maxwidth = Number(panel_4)  # disabled
pt_points_2 = Point(pt_points)  # disabled

# ----
panel_5 = Panel("30")  # disabled

# ---- group: Voronoi Buildings
num_buildingdensity = Number(panel_5)  # disabled
crv_blocks_3 = Curve(simplify(graft(dispatch_2.ListB)))  # disabled

# ----
panel_6 = Panel("5")  # disabled
panel_7 = Panel("12")  # disabled

# ---- group: Voronoi Buildings
bbox = BoundingBox(Content=crv_blocks_3, Plane=PlaneXY(0, 0, 0))  # -> Box, Box_2; disabled
area_3 = Area(Geometry=bbox.Box)  # -> Area, Centroid; disabled
division = Division(A=area_3.Area, B=num_buildingdensity)  # disabled
pop2d = Populate2D(Region=bbox.Box, Count=division, Seed=1)  # -> simplify(Population); disabled
incurve = PointInCurve(Point=pop2d, Curve=crv_blocks_3)  # -> Relationship, Point; disabled
cull_3 = CullPattern(List=pop2d, CullPattern=incurve.Relationship)  # disabled
voronoi = Voronoi(Points=cull_3, Boundary=bbox.Box, BruteForceOverride=False)  # -> simplify(Cells); disabled
boundary_3 = BoundarySurfaces(Edges=voronoi)  # disabled
srfsplit_4 = SurfaceSplit(Surface=boundary_3, Curves=crv_blocks_3)  # disabled
path_mapper = PathMapper(srfsplit_4, source="{A;B}", target="{A}")  # disabled
area_4 = Area(Geometry=path_mapper)  # -> Area, Centroid; disabled
incurve_2 = PointInCurve(Point=area_4.Centroid, Curve=crv_blocks_3)  # -> Relationship, Point; disabled
cull_4 = CullPattern(List=path_mapper, CullPattern=incurve_2.Relationship)  # disabled
edges_3 = BrepEdges(Brep=cull_4)  # -> Naked, Interior, NonManifold; disabled
join_5 = JoinCurves(Curves=edges_3.Naked, Preserve=False)  # disabled
panel_8 = Panel("1")  # disabled
panel_9 = Panel("4")  # disabled
reb = RebuildCurve(Curve=join_5, Degree=panel_8, Count=panel_9, Tangents=False)  # -> simplify(Curve); disabled
path_mapper_2 = PathMapper(reb, source="{A;B}", target="{A}")  # disabled
crv_buildingfootprints = Curve(path_mapper_2)  # disabled

# ----
panel_10 = Panel("0.9")  # disabled
panel_11 = Panel("2")  # disabled
panel_12 = Panel("4")  # disabled
panel_13 = Panel("20")  # disabled
brep = Brep([<brep referenced from the Rhino model> x2])  # disabled

# ---- group: Topography
panel_14 = Panel("15")  # disabled
sdivide = DivideSurface(Surface=boundary, UCount=panel_14, VCount=panel_14)  # -> Points, Normals, Parameters; disabled
graft_3 = GraftTree(Tree=sdivide.Points, IncludeEmptyLists=True, IncludeNullItems=True)  # disabled
dist = Distance(PointA=pts_topography, PointB=graft_3)  # disabled
sort_3 = SortList(Keys=dist)  # -> Keys, ValuesA; disabled
item_4 = ListItem(List=sort_3.Keys, Index=0, Wrap=True)  # disabled

# ---- group: Topography / Remapping
panel_15 = Panel("50")  # disabled
panel_16 = Panel("0")  # disabled
flatten_3 = FlattenTree(Tree=item_4, Path="{0}")  # disabled
dom = ConstructDomain(DomainStart=panel_15, DomainEnd=panel_16)  # disabled
bnd = Bounds(Numbers=flatten_3)  # disabled
remap = RemapNumbers(Value=item_4, Source=bnd, Target=dom)  # -> Mapped, Clipped; disabled

# ---- group: Topography (continued)
Z = UnitZ(Factor=remap.Mapped)  # disabled
move = Move(Geometry=graft_3, Motion=Z)  # -> simplify(Geometry), Transform; disabled
path_mapper_3 = PathMapper(move.Geometry, source="{A;B}", target="{A}")  # disabled
viewer = ParamViewer(path_mapper_3)  # disabled
lng_2 = ListLength(List=viewer)  # disabled
points = PointList(Points=path_mapper_3)  # disabled
srfgrid = SurfaceFromPoints(Points=flatten(path_mapper_3), UCount=lng_2, Interpolate=False)  # disabled
srf_topography_2 = Surface(srfgrid)  # disabled

# ----
srf_topography_3 = Surface(srf_topography_2)  # disabled

# ---- group: Building Widths
len = Length(Curve=crv_blocks_2)  # disabled
area_5 = Area(Geometry=crv_blocks_2)  # -> Area, Centroid; disabled

# ---- group: Building Widths / Remap
dist_2 = Distance(PointA=area_5.Centroid, PointB=pt_points_2)  # disabled
sort_4 = SortList(Keys=dist_2)  # -> Keys, ValuesA; disabled
panel_17 = Panel("0")  # disabled
item_5 = ListItem(List=sort_4.Keys, Index=panel_17, Wrap=True)  # disabled
bnd_2 = Bounds(Numbers=flatten(item_5))  # disabled
remap_2 = RemapNumbers(Value=item_5, Source=bnd_2, Target=Domain(0, 1))  # -> Mapped, Clipped; disabled
dom_2 = ConstructDomain(DomainStart=num_maxwidth, DomainEnd=num_minwidth)  # disabled
graph = GraphMapper(
    remap_2.Mapped,
    x0=0,
    x1=1,
    y0=0,
    y1=1,
    container_name="Bezier",
    cpx=[0, 0.1112657934, 0.01050777733, 1],
    cpy=[0, 0.762670517, 1, 1])  # disabled
remap_3 = RemapNumbers(Value=graph, Source=Domain(0, 1), Target=dom_2)  # -> Mapped, Clipped; disabled

# ---- group: Building Widths (continued)
division_2 = Division(A=len, B=remap_3.Mapped)  # disabled
divide = DivideCurve(Curve=crv_blocks_2, Count=division_2, Kinks=False)  # -> Points, Tangents, Parameters; disabled
shift = ShiftList(List=divide.Points, Shift=1, Wrap=True)  # disabled
ln_3 = Line(StartPoint=divide.Points, EndPoint=shift)  # disabled
crv_buildingfronts = Curve(ln_3)  # disabled

# ---- group: Building Depth
num_maxdepth = Number(panel_7)  # disabled
crv_buildingfronts_2 = Curve(simplify(graft(crv_buildingfronts)))  # disabled
num_mindepth = Number(panel_6)  # disabled
crv_streets_5 = Curve(flatten(crv_streets_3))  # disabled
pt_points_3 = Point(pt_points)  # disabled

midpt = CurveMiddle(Curve=crv_buildingfronts_2)  # disabled
crv_cp = CurveClosestPoint(Point=midpt, Curve=crv_streets_5)  # -> Point, Parameter, Distance; disabled
sort_5 = SortList(Keys=crv_cp.Distance, ValuesA=crv_cp.Point)  # -> Keys, ValuesA; disabled
item_6 = ListItem(List=sort_5.ValuesA, Index=0, Wrap=True)  # disabled
vec2pt = Vector2Pt(PointA=item_6, PointB=midpt, Unitize=False)  # -> Vector, Length; disabled
end_3 = EndPoints(Curve=crv_buildingfronts_2)  # -> Start, End; disabled

# ---- group: Building Depth / Remap
dist_3 = Distance(PointA=midpt, PointB=pt_points_3)  # disabled
sort_6 = SortList(Keys=dist_3)  # -> Keys, ValuesA; disabled
panel_18 = Panel("0")  # disabled
item_7 = ListItem(List=sort_6.Keys, Index=panel_18, Wrap=True)  # disabled
bnd_3 = Bounds(Numbers=flatten(item_7))  # disabled
dom_3 = ConstructDomain(DomainStart=num_maxdepth, DomainEnd=num_mindepth)  # disabled
remap_4 = RemapNumbers(Value=item_7, Source=bnd_3, Target=Domain(0, 1))  # -> Mapped, Clipped; disabled
graph_2 = GraphMapper(remap_4.Mapped, x0=0, x1=1, y0=0, y1=1, container_name="Bezier", cpx=[0, 0.07963832468, 0, 1], cpy=[0, 0, 1, 1])  # disabled
remap_5 = RemapNumbers(Value=graph_2, Source=Domain(0, 1), Target=dom_3)  # -> Mapped, Clipped; disabled

# ---- group: Building Depth (continued)
amp = Amplitude(Vector=vec2pt.Vector, Amplitude=remap_5.Mapped)  # disabled
move_2 = Move(Geometry=crv_buildingfronts_2, Motion=amp)  # -> Geometry, Transform; disabled
end_4 = EndPoints(Curve=move_2.Geometry)  # -> Start, End; disabled
merge = Merge(Data1=end_3.Start, Data2=end_3.End, Data3=end_4.End, Data4=end_4.Start)  # disabled
pline = PolyLine(Vertices=merge, Closed=True)  # disabled
path_mapper_4 = PathMapper(pline, source="{A;B}", target="{A}")  # disabled
crv_buildingfootprints_2 = Curve(path_mapper_4)  # disabled

# ---- group: Topograpy_Building Footprints
crv_building_footprints = Curve([crv_buildingfootprints_2, crv_buildingfootprints])  # disabled
srf_topography_4 = Surface(srf_topography)  # disabled

cp = ControlPoints(Curve=crv_building_footprints)  # -> Points, Weights, Knots; disabled
Z_2 = UnitZ(Factor=1)  # disabled
line = LineSDL(Start=cp.Points, Direction=Z_2, Length=1)  # disabled
slx = SurfaceLine(Surface=srf_topography_4, Line=line, LimitToFirst=False)  # -> Curves, Points, UVPoints, Normal; disabled
path_mapper_5 = PathMapper(slx.Points, source="{A;B;C}", target="{A;B}")  # disabled
pdecon = Deconstruct(Point=path_mapper_5)  # -> XComponent, YComponent, ZComponent; disabled
sort_7 = SortList(Keys=pdecon.ZComponent, ValuesA=path_mapper_5, ValuesB=cp.Points)  # -> Keys, ValuesA, ValuesB; disabled
item_8 = ListItem(List=sort_7.ValuesA, Index=0, Wrap=True)  # disabled
item_9 = ListItem(List=sort_7.ValuesB, Index=0, Wrap=True)  # disabled
vec2pt_2 = Vector2Pt(PointA=item_9, PointB=item_8, Unitize=False)  # -> Vector, Length; disabled
path_mapper_6 = PathMapper(vec2pt_2.Vector, source="{A;B}", target="{A}")  # disabled
move_3 = Move(Geometry=crv_building_footprints, Motion=path_mapper_6)  # -> Geometry, Transform; disabled
crv_buildingfootprints_3 = Curve(move_3.Geometry)  # disabled

# ----
crv_building_footprints_2 = Curve(crv_buildingfootprints_3)  # disabled

# ---- group: Building Heights
crv_buildingfootprints_4 = Curve(crv_building_footprints_2)  # disabled
num_minheight = Number(panel_12)  # disabled
num_maxheight = Number(panel_13)  # disabled
num_minadjust = Number(panel_10)  # disabled
num_maxadjust = Number(panel_11)  # disabled
pt_points_4 = Point(pt_points)  # disabled

pcen = PolygonCenter(Polyline=crv_buildingfootprints_4)  # -> CenterV, CenterE, CenterA; disabled
lng_3 = ListLength(List=crv_buildingfootprints_4)  # disabled
dom_4 = ConstructDomain(DomainStart=num_minadjust, DomainEnd=num_maxadjust)  # disabled
avr = Average(Input=pcen.CenterV)  # disabled
range = Range(Domain=dom_4, Steps=expr("x-1", lng_3))  # disabled
jitter = Jitter(List=range, Jitter=1, Seed=2)  # -> Values, Indices; disabled

# ---- group: Building Heights / Remap
dist_4 = Distance(PointA=avr, PointB=pt_points_4)  # disabled
sort_8 = SortList(Keys=dist_4)  # -> Keys, ValuesA; disabled
panel_19 = Panel("0")  # disabled
item_10 = ListItem(List=sort_8.Keys, Index=panel_19, Wrap=True)  # disabled
bnd_4 = Bounds(Numbers=flatten(item_10))  # disabled
dom_5 = ConstructDomain(DomainStart=num_maxheight, DomainEnd=num_minheight)  # disabled
remap_6 = RemapNumbers(Value=item_10, Source=bnd_4, Target=Domain(0, 1))  # -> Mapped, Clipped; disabled
graph_3 = GraphMapper(
    remap_6.Mapped,
    x0=0,
    x1=1,
    y0=0,
    y1=1,
    container_name="Bezier",
    cpx=[0, 0.1778936684, 0, 1],
    cpy=[0, 0.5957272053, 1, 1])  # disabled
remap_7 = RemapNumbers(Value=graph_3, Source=Domain(0, 1), Target=dom_5)  # -> Mapped, Clipped; disabled

# ---- group: Building Heights (continued)
Z_3 = UnitZ(Factor=remap_7.Mapped)  # disabled
dup_2 = DuplicateData(Data=Z_3, Number=lng_3, Order=True)  # disabled
multiplication = Multiplication(A=jitter.Values, B=dup_2)  # disabled

vec_height = Vector(simplify(graft(multiplication)))  # disabled
panel_20 = Panel("2")  # disabled
cp_2 = ControlPoints(Curve=crv_buildingfootprints_4)  # -> Points, Weights, Knots; disabled
panel_21 = Panel("1")  # disabled
panel_22 = Panel("0")  # disabled
panel_23 = Panel("3")  # disabled
item_11 = ListItem(List=cp_2.Points, Index=panel_22, Wrap=True)  # disabled
item_12 = ListItem(List=cp_2.Points, Index=panel_21, Wrap=True)  # disabled
item_13 = ListItem(List=cp_2.Points, Index=panel_20, Wrap=True)  # disabled
item_14 = ListItem(List=cp_2.Points, Index=panel_23, Wrap=True)  # disabled
move_4 = Move(Geometry=item_11, Motion=vec_height)  # -> Geometry, Transform; disabled
move_5 = Move(Geometry=item_12, Motion=vec_height)  # -> Geometry, Transform; disabled
move_6 = Move(Geometry=item_13, Motion=vec_height)  # -> Geometry, Transform; disabled
move_7 = Move(Geometry=item_14, Motion=vec_height)  # -> Geometry, Transform; disabled
tbox = TwistedBox(
    CornerA=item_11,
    CornerB=item_12,
    CornerC=item_13,
    CornerD=item_14,
    CornerE=move_4.Geometry,
    CornerF=move_5.Geometry,
    CornerG=move_6.Geometry,
    CornerH=move_7.Geometry)  # disabled

geo_buildingenvelope = Geometry(tbox)  # disabled
mesh = Mesh(tbox)  # disabled

# ---- group: Mapped Mesh Envelope
brep_2 = Brep(graft(geo_buildingenvelope))  # disabled
bbox_2 = BoundingBox(Content=brep_2, Plane=PlaneXY(0, 0, 0))  # -> Box, Box_2; disabled
debox = DeconstructBox(Box=bbox_2.Box)  # -> Plane, X, Y, Z; disabled
mesh_2 = MeshBrep(
    Brep=brep_2,
    Settings={GridMaxCount=0, GridMinCount=16, JaggedSeams=False, MaxEdgeLength=0, MinEdgeLength=0.0001, MinTolerance=0, Refine=True, RefineAngle=0, RelativeTolerance=0.65, SimplePlanes=True, Tolerance=0})  # disabled
dedomain = DeconstructDomain(Domain=debox.X)  # -> Start, End; disabled
dedomain_2 = DeconstructDomain(Domain=debox.Y)  # -> Start, End; disabled
dedomain_3 = DeconstructDomain(Domain=debox.Z)  # -> Start, End; disabled
subtraction = Subtraction(A=dedomain_3.End, B=dedomain_3.Start)  # disabled
panel_24 = Panel("4")  # disabled
division_3 = Division(A=subtraction, B=panel_24)  # disabled
int = Integer(division_3)  # disabled
division_4 = Division(A=subtraction, B=int)  # disabled
panel_25 = Panel("2")  # disabled
division_5 = Division(A=division_4, B=panel_25)  # disabled
addition = Addition(A=dedomain_3.Start, B=division_5)  # disabled
pt = ConstructPoint(XCoordinate=dedomain.Start, YCoordinate=dedomain_2.Start, ZCoordinate=addition)  # disabled
box = CenterBox(Base=pt, X=division_5, Y=division_5, Z=division_5)  # disabled
path = FilePath("C:\Users\mconway\Downloads\UCLA\testtexture.PNG")  # disabled

# ----
boxmap = BoxMapping(Mesh=mesh_2, Box=box)  # disabled

# ---- group: Mapped Mesh Envelope (continued)
previewmat = CustomPreviewMaterials(Geometry=boxmap, DiffuseColor=RGB(255, 255, 255), DiffuseBitmap=path)  # disabled
mesh_mappedenvelope = Mesh(boxmap)  # disabled

# ----
mesh_mappedenvelope_2 = Mesh(mesh_mappedenvelope)  # disabled
